# Grasshopper definition BrainCoral.gh (Grasshopper 1.0.7)
# plug-ins: FalseStartToggle, Bifocals, Weaverbird, Kangaroo2 Components

unit_z = UnitZ(Factor=1)
curve = Curve(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)
surface = Surface(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)
project = Project(Curve=curve, Brep=surface, Direction=unit_z)
divide_curve = DivideCurve(Curve=project, Count=Slider(2000, range=0..10000), Kinks=False)  # -> Points, Tangents, Parameters
polyline = PolyLine(Vertices=divide_curve.Points, Closed=False)
explode = Explode(Curve=polyline, Recursive=True)  # -> Segments, Vertices
discontinuity = Discontinuity(Curve=polyline, Level=2)  # -> Points, Parameters
number_slider = Slider(26, range=0..100)
length = Length(Curve=explode.Segments)
mesh_surface = MeshSurface(Surface=surface, UCount=number_slider, VCount=number_slider, Overhang=True, Equalize=False)
average = Average(Input=length)
multiplication = Multiplication(A=average, B=Slider(33, range=0..33))
spherecollide = SphereCollide(Points=discontinuity.Points, Radius=multiplication, Strength=1)
onmesh = OnMesh(Points=discontinuity.Points, Mesh=mesh_surface, Strength=Slider(100, range=0..100))
length_line = LengthLine(Line=explode.Segments, Length=multiplication, Strength=10)
merge = Merge(Data1=length_line, Data2=spherecollide, Data3=onmesh)
false_start_toggle = FalseStartToggle(False)
bouncysolver = BouncySolver(
    GoalObjects=merge,
    Reset=Button(),
    Threshold=1e-15,
    Tolerance=0.01,
    Damping=Slider(0.95, range=0..1),
    Iterations=Slider(50, range=0..100),
    On=false_start_toggle)  # -> I, V, O
surface_2 = Surface(surface)
point = Point(bouncysolver.V)
line = Line(bouncysolver.O)
surface_closest_point = SurfaceClosestPoint(Point=point, Surface=surface_2)  # -> Point, UVPoint, Distance
evaluate_surface = EvaluateSurface(Surface=surface_2, Point=surface_closest_point.Point)  # -> Point, Normal, UDirection, VDirection, Frame
amplitude = Amplitude(Vector=evaluate_surface.Point, Amplitude=Slider(20, range=1..50))
move = Move(Geometry=point, Motion=amplitude)  # -> Geometry, Transform
entwine = Entwine(Branch00=point, Branch01=move.Geometry, FlattenInputs=True)
nurbs_curve = NurbsCurve(Vertices=entwine, Degree=3, Periodic=False)  # -> flatten(Curve), Length, Domain
data_dam = DataDam(DataDataA=nurbs_curve.Curve, BufferDelay=10000000, BufferMode=0)
loft = Loft(Curves=data_dam, Options={Adjust=False, Closed=False, LoftEnds=0, LoftSimp=0, LoftType=0, Rebuild=10, Refit=0.01})
mesh_surface_2 = MeshSurface(Surface=loft, UCount=Slider(1, range=0..1), VCount=Slider(10000, range=0..10000), Overhang=True, Equalize=False)
weaverbird_s_mesh_thicken = WeaverbirdsMeshThicken(MeshCurves=mesh_surface_2, Distance=Slider(2, range=1..10), OffsetType=0)
custom_preview = CustomPreview(Geometry=weaverbird_s_mesh_thicken, Material=ColourSwatch(SwatchColor=RGBA(210, 6, 58, 150)))
